# Grasshopper definition HilbertGcode_3.gh (Grasshopper 1.0.7)

number_slider = Slider(1, range=0..1)
crv = Curve(<curve referenced from the Rhino model>)
crv_2 = Curve(<curve referenced from the Rhino model>)
crv_3 = Curve(<curve referenced from the Rhino model>)
python = GhPythonScript(crv=crv)  # -> out, a, b, c, d, depths; inputs crv: Curve
# ---------- python: Python ----------
import sys
import rhinoscriptsyntax as rs

import Rhino.Geometry as rg

sys.path.append("/Users/jonas/Documents/reps/spacemapping_curve/src/spacemapping_curve/matplotlib_qt")
sys.path.append("/Users/jonas/Documents/reps/spacemapping_curve/src/spacemapping_curve")

import quad_tree as qt
import distance as ds

reload(qt)
reload(ds)

global crv
class DistanceObject():
    
    def __init__(self):
        
        pass
        
    def get_distance(self, vec):
    
        v = rg.Point3d(vec.x, vec.y, vec.z)
        
        _, t_val = crv.ClosestPoint(v)
        pt_on_c = crv.PointAt(t_val)
        
        return 7 - (pt_on_c.DistanceTo(v) / 5.0) ** .5

# d_f_obj=DistanceObject()

d_f_obj = ds.SchwarzN(
    x_scale = .03,
    y_scale = .03,
    z_scale = .3,
    global_scale = 10.0,
    height = 1.0
)

d_f_obj = ds.PinchD(
    x_scale = .005,
    y_scale = .005,
    z_scale = .1,
    global_scale = 1.5,
    height = .5,
    r = 3., 
    s = 1.0,
    t = 1.0
)

# q_obj = qt.QuadObj(qt.distance_f)
q_obj = qt.QuadObj(d_f_obj, quad_type = '2/3', last_is_quad=2, max_levels = 8
)
q_obj.create()
b = q_obj.orientation_list()
a = rs.AddPolyline(q_obj.tuple_list())

d = []
for v_set in q_obj.get_boundaries():
    vs = []
    for v in v_set:
        vs.append(v.to_tuple() )
        
    d.append(rs.AddPolyline(vs + [vs[0] ] ) )
    
q_obj.adjusting()

depths = [node.d for node in q_obj.nodes]

# print(q_obj)
c = rs.AddPolyline(q_obj.tuple_list())
# ---------- end python ----------
divide = DivideCurve(Curve=python.a, Count=1, Kinks=True)  # -> Points, Tangents, Parameters
pt = ConstructPoint(XCoordinate=number_slider, YCoordinate=number_slider, ZCoordinate=0)
crv_4 = Curve(<curve referenced from the Rhino model>)
move = Move(Geometry=divide.Points, Motion=pt)  # -> Geometry, Transform
line = Line([Line((-9.775295744, 36.68960054, 0), (25.0458154, 44.86303009, 0)), Line((27.11306935, 18.77429912, 0), (-6.068227374, 4.791025848, 0)), Line((-5.291452759, -10.53860567, 0), (24.55276531, -22.33289179, 0)), Line((22.99152175, -31.9486564, 0), (-6.362311642, -34.18348633, 0)), Line((-7.384687033, -47.51971374, 0), (20.59465491, -61.82008381, 0))])
crv_5 = Curve(python.c)
crv_6 = Curve(python.a)
tag = TextTag(Location=move.Geometry, Text=python.b)
c_script = CSharpScript(crv=crv_4, tol=Slider(9.907, range=0..100))  # -> out, A; inputs crv: Curve, tol: Double
# ---------- c_script: C# ----------
void DivideCurve(Curve curve, double tStart, double tEnd, double tolerance, List<LineCurve> segments)
{
    Point3d startPoint = curve.PointAt(tStart);
    Point3d endPoint = curve.PointAt(tEnd);
    Point3d middlePoint = .5 * (startPoint + endPoint);

    double tClosest;
    curve.ClosestPoint(middlePoint, out tClosest);

    double distance = curve.PointAt(tClosest).DistanceTo(middlePoint);

    if (distance < tolerance) {
        segments.Add(new LineCurve(startPoint, endPoint) );
    }
    else {
        double tMiddle = .5 * (tStart + tEnd);
        DivideCurve(curve, tStart, tMiddle, tolerance, segments);
        DivideCurve(curve, tMiddle, tEnd, tolerance, segments);
    }
}

List<LineCurve> ln_crvs = new List<LineCurve>();

DivideCurve(crv, crv.Domain[0], crv.Domain[1], tol, ln_crvs);

A = ln_crvs;
# ---------- end c_script ----------
num = Number([0.25, 0.4, 0.65, 0.85])
number_slider_2 = Slider(7, range=0..10)
number_slider_3 = Slider(0, range=0..10)
crv_7 = Curve(python.d)
python_2 = GhPythonScript(x=python.depths)  # -> out, flatten(colors); inputs x: list
# ---------- python_2: Python ----------
import Rhino.Display as rd

colors = []

for d in x:
    colors.append(rd.Color4f(0.0,.0, d / 8 * 255.0, 255.0).ToString() )
# ---------- end python_2 ----------
c_script_2 = CSharpScript(x=Slider(5.3, range=0..10), y=Slider(2.9, range=0..10))  # -> out, A; inputs x: Double, y: Double
# ---------- c_script_2: C# ----------
double CalculateCylinderVolume(double r, double h)
{
    return 3.14 * r * h;
}

double result = CalculateCylinderVolume(x, y);
Print(result.ToString() );

A = result;
# ---------- end c_script_2 ----------
c_script_3 = CSharpScript(x=num, y=line)  # -> out, A, B; inputs x: list of Double, y: list of Line
# ---------- c_script_3: C# ----------
List<List> pt_lists = new List<List>();
List<Point3d> pts_list = new List<Point3d>();

foreach (Line ln in y){
    List<Point3d> loc_pts_list = new List<Point3d>();
    foreach (double t_val in x){
        Point3d loc_pt = Line.PointAt(t_val)
        loc_pts_list.Add(loc_pt);
        pts_list.Add(loc_pt);
    }
    pt_lists.Add(loc_pts_list);
}

A = pt_lists;
B = pts_list;
# ---------- end c_script_3 ----------
c_script_4 = CSharpScript(x=Slider(5.3, range=0..10), y=Slider(2.9, range=0..10), z=Slider(5.3, range=0..10), val=Slider(2.9, range=0..10))  # -> out, A; inputs x: Double, y: Double, z: Double, val: Double
# ---------- c_script_4: C# ----------
int PlusMethod(int X, int Y)
{
  return X + Y;
}

double PlusMethod(double X, double Y)
{
  return X + Y;
}

void Main(string[] args)
{
  int myNum1 = PlusMethod(8, 5);
  double myNum2 = PlusMethod(4.3, 6.26);
  Print("Int: " + myNum1);
  Print("Double: " + myNum2);
}

Main();
# ---------- end c_script_4 ----------
c_script_5 = CSharpScript(y=Toggle(False))  # -> out, A
# ---------- c_script_5: C# ----------
List<Point3d> points = new List<Point3d>();
List<Circle> circles = new List<Circle>();

for (double i = .5; i < 10.0; i += 6.5){
    for (double k = .5; k < 10.0; k += 6.5){
        points.Add(new Point3d(i, k, 0.0) );
    }
}

foreach (Point3d point in points){
    circles.Add(new Circle(point, 2.0) );
}

A = circles;
# ---------- end c_script_5 ----------
c_script_6 = CSharpScript(y=Toggle(False))  # -> out, A
# ---------- c_script_6: C# ----------
List<Point3d> myPoints = new List<Point3d>();

for (double i = .01; i < 20.0; i += .5){
    for (double j = .01; j < 20.0; j += .5){
        for (double k = .01; k < 20.0; k += .5){
            myPoints.Add(new Point3d(i, j, k) );
        }
    }
  }

A = myPoints;
# ---------- end c_script_6 ----------
c_script_7 = CSharpScript(x=Slider(8.4, range=0..10), y=Slider(3.9, range=0..10), z=Slider(7.4, range=0..10))  # -> out, A; inputs x: Double, y: Double, z: Double
# ---------- c_script_7: C# ----------
A = new Point3d(x, y, z);

List<double> myNumbers = new List<double>(){.5, 3.14};
myNumbers.Add(1.23);
myNumbers.Add(2.35);

foreach (var nmb in myNumbers) {
    Print(nmb.ToString() );
}

if (x<y)
{
    Print("x is smaller than y");
}
else
{
    Print("x is larger than y");
}

for (double i = 0; i < 5.0; i += .5)
{
    Print(i.ToString());
}

Print(" ");

for (int i = 10; i > 0; i -= 3)
{
    Print(i.ToString());
}
# ---------- end c_script_7 ----------
panel = Panel(c_script.out)
srf = Surface(flatten(crv_7))
line_2 = Line(c_script.A)
col = Colour(python_2.colors)
max = Maximum()
panel_2 = Panel(c_script_2.out)
sort = SortList(Keys=python.depths)  # -> Keys, ValuesA
panel_3 = Panel(c_script_4.out)
item = ListItem(List=sort.Keys, Index=0, Wrap=True)  # -> Item1, Item
gradient = Gradient(
    LowerLimit=item.Item,
    UpperLimit=item.Item1,
    Parameter=python.depths,
    stops=[0: RGB(243, 255, 255), 0.824: RGB(0, 59, 255)])
panel_4 = Panel(c_script_3.out)
panel_5 = Panel(python.out)
preview = CustomPreview(Geometry=srf, Material=gradient)
panel_6 = Panel(c_script_5.out)
